# Grasshopper definition run_tests_in_ironpython.gh (Grasshopper 1.0.7)

python = GhPythonScript()  # -> out, a
# ---------- python: Python ----------
from ladybug_geometry.geometry3d import Point3D, Vector3D, Mesh3D
from honeybee.model import Model
from honeybee.room import Room
from honeybee.face import Face
from honeybee.aperture import Aperture
from honeybee.door import Door
from honeybee_openstudio.openstudio import OSModel, OSSpace, openstudio
from honeybee_openstudio.writer import model_to_openstudio

from honeybee_energy.lib.programtypes import program_type_by_identifier

os_model = OSModel()
room = Room.from_box('Tiny_House', 15, 30, 10)
south_face = room[3]
south_face.apertures_by_ratio(0.4, 0.01)
south_face.apertures[0].overhang(0.5, indoor=False)
south_face.apertures[0].overhang(0.5, indoor=True)
south_face.apertures[0].move_shades(Vector3D(0, 0, -0.5))
room.properties.energy.program_type = \
    program_type_by_identifier('2019::MidriseApartment::Apartment')
model = Model('Tiny_House', [room])
os_model = model_to_openstudio(model, os_model)
# ---------- end python ----------
python_2 = GhPythonScript(test_dir="C:\Users\Chris\Documents\GitHub\honeybee-openstudio\tests", run=Toggle(False))  # -> out
# ---------- python_2: Python ----------
import os
import sys
import importlib
import inspect
from ladybug_rhino.grasshopper import all_required_inputs


def run_test_functions(module_name):
    for name, obj in inspect.getmembers(module_name):
        if inspect.isfunction(obj):
            if obj.__name__.startswith('test'):
                obj()
                print('Passed: {}'.format(obj.__name__))

EXCLUDE = ['__init__.py', 'cli_test.py']


if all_required_inputs(ghenv.Component) and _run:
    if _test_dir not in sys.path:
        sys.path.append(_test_dir)
    
    for test_mod in os.listdir(_test_dir):
        if os.path.isfile(os.path.join(_test_dir, test_mod)):
            if not test_mod in EXCLUDE:
                print(test_mod)
                test_mod = importlib.import_module(test_mod.replace('.py', ''))
                run_test_functions(test_mod)
# ---------- end python_2 ----------
panel = Panel(python_2)
